# Grasshopper definition definition.gh (Grasshopper 1.0.7)
# plug-ins: EleFront

filepath_path_csv = FilePath("C:\Users\Jake\Documents\repos\path_analysis_solution\logs\path.csv")
filepath_tracker_csv = FilePath("C:\Users\Jake\Documents\repos\path_analysis_solution\logs\tracker.csv")
checkpaths_py = GhPythonScript(Path=filepath_path_csv, Tracker=filepath_tracker_csv, Tol=Slider(0.1, range=0..1))  # -> out, PathBadPoints, PathBadPointCounts, CleanPathPoints, TrackerBadPoints, TrackerBadPointCounts, CleanTrackerPoints
# ---------- checkpaths_py: Python ----------
"""Provides a scripting component.
    This is a script running iniside a custom node in a visual scripting language
    called Grasshopper
    
    Inputs:
        Path: filepath to path.csv
        Tracker: filepath to tracker.csv
        Tol: duplicate point tolerance
        
    Outputs are visualized in Rhino-Grasshopper
"""

__author__ = "jake newsum"
__version__ = "2022.02.26"

import rhinoscriptsyntax as rs
import csv

class PathPoint():
    """ 
    get Index, Point, and T params from CSV
    Not sure what T param is for at this time
    """
    Point = None
    Index = None
    T = None
    
    def __init__(self, index, point, t):
        self.Index = index
        self.Point = point
        self.T = t

class PathPlanChecker():
    """
    PathPlan will be used to evaluate PathPoints
    """
    def __init__(self, pathPoints):
        
        self.PathPoints = pathPoints
        self.BadPathPoints = []
        self.BadPathPointCounts = []
    
    def RemoveDuplicatePoints(self, tol = 1.0):
        """ look for sequential duplicate points within tol"""
        uniquePathPoints = []
        uniquePathIndices = []
        searchPoint = None
        mostDuplicatesRemoved = 0
        numSequentialDuplicates = 0
        for p, pathPoint in enumerate(self.PathPoints):
            if p == 0:
                #get start point to begin
                uniquePathPoints.append(pathPoint)
                uniquePathIndices.append(p)
                searchPoint = pathPoint.Point
                continue
            #check if point is withing tol of searchPoint
            dist = rs.Distance(searchPoint, pathPoint.Point)
            if (dist > tol):
                uniquePathPoints.append(pathPoint)
                uniquePathIndices.append(p)
                searchPoint = pathPoint.Point
                if numSequentialDuplicates > 0:
                    self.BadPathPoints.append(pathPoint) #keep track of bad points
                    self.BadPathPointCounts.append(numSequentialDuplicates) #store count for visual
                if numSequentialDuplicates > mostDuplicatesRemoved:
                    mostDuplicatesRemoved = numSequentialDuplicates #get most
                numSequentialDuplicates = 0 #always reset counter
            else:
                numSequentialDuplicates+=1
        print "Removed: ", len(uniquePathIndices)
        print "Most Sequential Removed: ", mostDuplicatesRemoved
        return uniquePathPoints

def ReadPathPointsCSV (csvPath):
    pathPoints = []
    
    with open(csvPath, 'rb') as csvFile:
        dialect = csv.Sniffer().sniff(csvFile.read(1024))
        csvReader = csv.reader(csvFile, dialect)
        
        for l, line in enumerate(csvReader):
            #if l > 10000: break # run fast when debugging
            
            if l == 0:
                #skip header
                continue
            index = int(line[1])
            point = rs.AddPoint(float(line[2]), float(line[3]), float(line[4]))
            t = float(line[5])
            pathPoint = PathPoint(index, point, t)
            pathPoints.append(pathPoint)
            
    return pathPoints

def WritePathPointsCSV(pathPoints, csvPath):
    
    return true

def main(path, tracker, tol):
    """
    Thoughts:
        Need read the csv files into points
        Need to figure out the transfrom from path to tracker
        Need to inspect path and tracker points to find issues:
            robot failed to follow path
            "does its best" to go to points in order
            'just sat there unmoving" 
        Why would a robot fail to move for a moment along a path?:
            Could be the motion parameters - velocity, acceleration, approximation...
            Could be point distribution - can't read points fast enough
            Could be network issue if streaming:
            Could be workspace or safety issue - 
                robots slow to almost 0 mm/s when close to Workspace boundary
        What can I check with the data?:
            See if there is the tool stops in similare areas
            See if there are issues in path.csv in the areas tracker.csv at the same location
            find transform between points
    """
    
    
    # Read point in from path.csv to inspect input to robot
    pathPoints = ReadPathPointsCSV(path)
    # check to see if pathPoints have bad data
    pathChecker = PathPlanChecker(pathPoints)
    cleanPathPathPoints = pathChecker.RemoveDuplicatePoints(tol)
    # output cleanPoints for visualization in grasshopper
    cleanPathPoints = [pPoint.Point for pPoint in cleanPathPathPoints]
    pathBadPathPoints = pathChecker.BadPathPoints
    # output badPoints and counts for visualization in grasshopper
    pathBadPoints = [pPoint.Point for pPoint in pathBadPathPoints]
    pathBadPointCounts = pathChecker.BadPathPointCounts
    # write clean csv - try running this on the robot to see if it resolves the issues
    
    #WritePathPointsCSV(cleanPathPathPoints) - TODO
    
    """ looks like there were sequential duplicate points
    This could cause the robot to have trouble moving in a smooth path
    if the APO.CIS is set larget than tol (1.0), then the robot would have
    trouble interpolating through these points.
    There would also be issues if the robot is moving faster than the
    controller can process the points. This is especially problematic when 
    streaming points using UDP/TCP protocols. 
    In this case, many of the points  are 0.0mm appart, so the robot is being
    told to move to the same location which is why it appears to stop.
    
    Inspection - with Tol set to 0.01mm 40 pathPoints had duplicates.
    The first point had 96 duplicates and the others had 119.
    See image - DuplicatePathCounts.png
    Try running the cleanPath.csv to see if this fixes this issue.
    """
    
    """
    Check tracker.csv:
        Need to find transform to overlay points
        See how fast tool was moving by point distribution
        Check to see where the tool stopped
        Make sure it matches areas where path had duplicate points
    """
    trackerPoints = ReadPathPointsCSV(tracker)
    trackerChecker = PathPlanChecker(trackerPoints)
    cleanTrackerPathPoints = trackerChecker.RemoveDuplicatePoints(tol)
    cleanTrackerPoints = [pPoint.Point for pPoint in cleanTrackerPathPoints]
    trackerBadPathPoints = trackerChecker.BadPathPoints
    trackerBadPoints = [pPoint.Point for pPoint in trackerBadPathPoints]
    trackerBadPointCounts = trackerChecker.BadPathPointCounts
    
    """
    After comparing duplicate points of path and tracker,
    it seems the duplicate points did coorelate with the concentrations of points
    in tracker.csv. (see images)
    """
    
    """
    To find the transform and aling paths, I used Grasshopper. It is much
    easier to write and visualize the code with their native tools. 
    I always use the appropriate tools for the job, and this is a great example.
    
    I found the centered average plane for each path and tracker
    To do this I found the average of all points to be the origin
    I found the 2 farthest points away from each other to be X vector
    I then found the normal of the average plane from all points
    This gave me a great approximate plane for both collections
    You can see t he point overlays with errors in images.
    """
    
    tPoints = None
    return pathBadPoints, pathBadPointCounts, cleanPathPoints, trackerBadPoints, trackerBadPointCounts, cleanTrackerPoints


if __name__ == "__main__":
    PathBadPoints, PathBadPointCounts, CleanPathPoints, TrackerBadPoints, TrackerBadPointCounts, CleanTrackerPoints = main(Path, Tracker, Tol)
# ---------- end checkpaths_py ----------

# ---- group: Get Average Plane and Orient to XY Plane Origin
pt = Point(checkpaths_py.CleanTrackerPoints)
crv = Curve(<curve referenced from the Rhino model>)
avr = Average(Input=pt)
plfit = PlaneFit(Points=pt)  # -> Plane, Deviation
end = EndPoints(Curve=crv)  # -> Start, End
pl_origin = PlaneOrigin(Base=plfit.Plane, Origin=avr)
vec2pt = Vector2Pt(PointA=end.End, PointB=end.Start, Unitize=False)  # -> Vector, Length
align = AlignPlane(Plane=pl_origin, Direction=vec2pt.Vector)  # -> Plane, Angle
orient = Orient(Geometry=pt, Source=align.Plane, Target=PlaneXY(0, 0, 0))  # -> Geometry, Transform
kuka_frame = CSharpScript(Target=align.Plane)  # -> out, X, Y, Z, A, B, C; inputs Target: Plane
# ---------- kuka_frame: C# ----------
    X = Target.OriginX;
    Y = Target.OriginY;
    Z = Target.OriginZ;
    double a;
    double b;
    double c;

    //Get Transform from Base to Plane
    var t = Rhino.Geometry.Transform.PlaneToPlane(Plane.WorldXY, Target);
    double tol = 1.0e-7;

    if (t.M20 < (-1.0 + tol)) {
      a = Math.Atan2(t.M01, t.M11);
      b = -Math.PI / 2.0;
      c = 0.0;
    }
    else if (t.M20 > (1.0 - tol)) {
      a = Math.Atan2(t.M01, t.M11);
      b = Math.PI / 2.0;
      c = 0.0;
    }
    else {
      a = Math.Atan2(-t.M10, t.M00);
      double mult = 1.0 - t.M20 * t.M20;
      if (Math.Abs(mult) < tol) {
        mult = 0.0;
      }
      b = Math.Atan2(t.M20, Math.Sqrt(mult));
      c = Math.Atan2(-t.M21, t.M22);
    }

    A = -RadToDeg(a);
    B = -RadToDeg(b);
    C = -RadToDeg(c);
# ---------- kuka_frame: C# additional code ----------
  private double
    RadToDeg(double angleRad)
  {
    return angleRad * 180.0 / Math.PI;
  }
# ---------- end kuka_frame ----------
plane_of_tracker_csv = Panel([kuka_frame.X, kuka_frame.Y, kuka_frame.Z, kuka_frame.A, kuka_frame.B, kuka_frame.C])

# ---- group: Get path.csv Average Plane and Orient to XY Plane Origin
pt_2 = Point(checkpaths_py.CleanPathPoints)
crv_2 = Curve(<curve referenced from the Rhino model>)
avr_2 = Average(Input=pt_2)
plfit_2 = PlaneFit(Points=pt_2)  # -> Plane, Deviation
end_2 = EndPoints(Curve=crv_2)  # -> Start, End
pl_origin_2 = PlaneOrigin(Base=plfit_2.Plane, Origin=avr_2)
vec2pt_2 = Vector2Pt(PointA=end_2.Start, PointB=end_2.End, Unitize=False)  # -> Vector, Length
align_2 = AlignPlane(Plane=pl_origin_2, Direction=vec2pt_2.Vector)  # -> Plane, Angle
kuka_frame_2 = CSharpScript(Target=align_2.Plane)  # -> out, X, Y, Z, A, B, C; inputs Target: Plane; same code as kuka_frame
orient_2 = Orient(Geometry=pt_2, Source=align_2.Plane, Target=PlaneXY(0, 0, 0))  # -> Geometry, Transform
plane_of_path_csv = Panel([kuka_frame_2.X, kuka_frame_2.Y, kuka_frame_2.Z, kuka_frame_2.A, kuka_frame_2.B, kuka_frame_2.C])

# ----
pt_3 = Point(checkpaths_py.TrackerBadPoints)
pt_4 = Point(checkpaths_py.PathBadPoints)
deplane = DeconstructPlane(Plane=PlaneXY(0, 0, 0))  # -> Origin, XAxis, YAxis, ZAxis
orient_3 = Orient(Geometry=pt_3, Source=align.Plane, Target=PlaneXY(0, 0, 0))  # -> Geometry, Transform
orient_4 = Orient(Geometry=pt_4, Source=align_2.Plane, Target=PlaneXY(0, 0, 0))  # -> Geometry, Transform
pt_5 = Point(orient_3.Geometry)
int = Integer(checkpaths_py.TrackerBadPointCounts)
int_2 = Integer(checkpaths_py.PathBadPointCounts)
pt_6 = Point(orient_4.Geometry)

# ---- group: Show Path Duplicate Counts
pt_7 = Point(checkpaths_py.CleanPathPoints)
pline = PolyLine(Vertices=pt_7, Closed=False)
Z = UnitZ(Factor=Slider(31, range=0..100))
move = Move(Geometry=pt_6, Motion=Z)  # -> Geometry, Transform
ln = Line(StartPoint=pt_6, EndPoint=move.Geometry)
textdot = DefineTextDot(Text=int_2, Location=move.Geometry, Font="Arial", Size=14)
preview = CustomPreview(Geometry=textdot, Material=ColourSwatch(SwatchColor=RGB(0, 255, 85)))

# ---- group: Show Tracked Duplicate Counts
number_slider = Slider(31, range=0..100)
pt_8 = Point(checkpaths_py.CleanTrackerPoints)
pline_2 = PolyLine(Vertices=pt_8, Closed=False)
Y = UnitY(Factor=number_slider)

# ----
neg = Negative(Value=number_slider)
Z_2 = UnitZ(Factor=neg)

# ---- group: Show Tracked Duplicate Counts (continued)
move_2 = Move(Geometry=pt_5, Motion=Z_2)  # -> Geometry, Transform
ln_2 = Line(StartPoint=pt_5, EndPoint=move_2.Geometry)
textdot_2 = DefineTextDot(Text=int, Location=move_2.Geometry, Font="Arial", Size=14)
preview_2 = CustomPreview(Geometry=textdot_2, Material=ColourSwatch(SwatchColor=RGB(255, 0, 0)))
